# Grasshopper definition Subtype Classification_gh_shared.gh (Grasshopper 1.0.7)
# plug-ins: Rhino.Inside for Autodesk Revit, MinimumBoundingBox, treesloth01, Wombat, MetaHopper, Pufferfish

# ---- group: Query
input_ids = Panel("###,###")
text_split = TextSplit(Text=input_ids, Separators=",")
text_trim = TextTrim(Text=text_split, Start=True, End=True)  # -> flatten(Result)
query_element = QueryElement(Id=text_trim)

# ---- group: Basic
elem2geo = ElementGeometry(Elements=query_element)
volume = Volume(Geometry=elem2geo)  # -> Volume, Centroid
min_bbox = MinimumBoundingBox3D(Content=elem2geo)
volume_2 = Volume(Geometry=min_bbox)  # -> Volume, Centroid

# ---- group: Selection
panel = Panel("""Wall
Else""")
text = Text(query_element)
panel_2 = Panel(":")
text_split_2 = TextSplit(Text=text, Separators=panel_2)
first_last = FirstLast(List=text_split_2)  # -> FirstValue, LastValue
panel_3 = Panel("Revit Wall ")
panel_4 = Panel("Wall")
panel_5 = Panel("Else")
boolean_toggle = BooleanToggle(True)
expression = Expression(x=first_last.FirstValue, y=panel_3, z=panel_4, u=panel_5, Expression="If(x=y, z, u)")  # -> simplify(Result)
set_difference_s = SetDifferenceS(SetA=panel, SetB=expression)
objectbynickname = GetObjectByNickname(NickName=expression)
objectbynickname_2 = GetObjectByNickname(NickName=set_difference_s)
boolean_toggle_2 = BooleanToggle(False)
objects_in_group = GetObjectsInGroup(Group=objectbynickname)
objects_in_group_2 = GetObjectsInGroup(Group=objectbynickname_2)
enable_disable = EnableDisableObject(
    Objects=objects_in_group,
    Enabled=boolean_toggle,
    AllObjects_Object=[text, text_split_2, panel_2, first_last, expression, panel_3, panel_4, objectbynickname, boolean_toggle, set_difference_s, panel, objectbynickname_2, boolean_toggle_2, panel_5])
enable_disable_2 = EnableDisableObject(
    Objects=objects_in_group_2,
    Enabled=boolean_toggle_2,
    AllObjects_Object=[query_elements, and_filter, category_filter, category, intersects_brep_filter, deconstruct_brep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])

# ---- group: Wall
# Floors
# Structural
# Foundations
deconstruct_brep = DeconstructBrep(Brep=min_bbox)  # -> Faces, Edges, Vertices; disabled
unit_z = UnitZ(Factor=-10)  # disabled
category = Category(<category referenced from the Revit model>)  # disabled
category_2 = Category(<category referenced from the Revit model>)  # disabled
decon_vec = DeconstructVector(Vector=deconstruct_brep.Vertices)  # -> XComponent, YComponent, ZComponent; disabled
category_filter = CategoryFilter(Categories=category, Inverted=False)  # disabled
category_filter_2 = CategoryFilter(Categories=category_2, Inverted=False)  # disabled
sort_list = SortList(Keys=decon_vec.ZComponent, ValuesValuesA=deconstruct_brep.Vertices)  # -> Keys, ValuesValuesA; disabled
first_last_2 = FirstLast(List=sort_list.Keys)  # -> FirstValue, LastValue; disabled
list_item = ListItem(List=sort_list.ValuesValuesA, Index=0, Wrap=True)  # disabled
list_item_2 = ListItem(List=sort_list.ValuesValuesA, Index=1, Wrap=True)  # disabled
list_item_3 = ListItem(List=sort_list.ValuesValuesA, Index=2, Wrap=True)  # disabled
list_item_4 = ListItem(List=sort_list.ValuesValuesA, Index=3, Wrap=True)  # disabled
subtraction = Subtraction(A=first_last_2.LastValue, B=first_last_2.FirstValue)  # disabled
_4point_surface = _4PointSurface(CornerA=list_item, CornerB=list_item_2, CornerC=list_item_3, CornerD=list_item_4)  # disabled
addition = Addition(A=subtraction, B=20)  # disabled
move = Move(Geometry=_4point_surface, Motion=unit_z)  # -> Geometry, Transform; disabled
unit_z_2 = UnitZ(Factor=addition)  # disabled
logical_or_filter = LogicalOrFilter(FilterA=category_filter, FilterB=category_filter_2)  # disabled
extrude = Extrude(Base=move.Geometry, Direction=unit_z_2)  # disabled
intersects_brep_filter = IntersectsBrepFilter(Brep=extrude, Inverted=False)  # disabled
and_filter = LogicalAndFilter(FilterA=intersects_brep_filter, FilterB=logical_or_filter)  # disabled
query_elements = QueryElements(Filter=and_filter, Limit=100)  # -> Elements, simplify(Count); disabled

round_to_factor = RoundToFactor(NumberX=volume_2.Volume, Factor=10000, RoundType=0)  # -> Rounded, Difference, MultiplierR, MultiplierX; disabled
round_to_factor_2 = RoundToFactor(NumberX=volume.Volume, Factor=10000, RoundType=0)  # -> Rounded, Difference, MultiplierR, MultiplierX; disabled
larger_than = LargerThan(FirstNumber=round_to_factor.Rounded, SecondNumber=round_to_factor_2.Rounded)  # -> simplify(LargerThan), OrEqualTo; disabled

# Base
# Constraint
parameter = Parameter(<parameter referenced from the Revit model>, SelectedBuiltInCategory="autodesk.revit.category.local:walls")  # disabled
element_parameter = ElementParameter(Element=query_element, Parameter=parameter)  # -> Element, graft(Value); disabled
level_filter = LevelFilter(Levels=element_parameter.Value, Inverted=False)  # disabled
and_filter_2 = LogicalAndFilter(FilterA=level_filter, FilterB=logical_or_filter)  # disabled
panel_6 = Panel("0")  # disabled
text_2 = Text(panel_6)  # disabled
query_elements_2 = QueryElements(Filter=and_filter_2, Limit=100)  # -> simplify(Elements), Count; disabled
elem2geo_2 = ElementGeometry(Elements=query_elements_2.Elements)  # disabled
shift_paths = ShiftPaths(Data=elem2geo_2, Offset=-1)  # disabled
decon_brep = DeconstructBrep(Brep=shift_paths)  # -> Faces, Edges, Vertices; disabled
box_properties = BoxProperties(Box=decon_brep.Faces)  # -> Center, Diagonal, Area, Volume, Degeneracy; disabled
shift_paths_2 = ShiftPaths(Data=decon_brep.Vertices, Offset=-1)  # disabled
first_last_3 = FirstLast(List=shift_paths_2)  # -> FirstValue, LastValue; disabled
decon_vec_2 = DeconstructVector(Vector=box_properties.Diagonal)  # -> XComponent, YComponent, ZComponent; disabled
xy_plane = XYPlane(Origin=first_last_3.LastValue)  # -> simplify(Plane); disabled
text_3 = Text(decon_vec_2.ZComponent)  # disabled
member_index = MemberIndex(Set=text_3, Member=text_2)  # -> Index, Count; disabled
list_item_5 = ListItem(List=decon_brep.Faces, Index=member_index.Index, Wrap=True)  # -> simplify(Item); disabled
first_last_4 = FirstLast(List=list_item_5)  # -> FirstValue, LastValue; disabled
shift_paths_3 = ShiftPaths(Data=first_last_4.FirstValue, Offset=-1)  # disabled
decon_brep_2 = DeconstructBrep(Brep=shift_paths_3)  # -> Faces, Edges, Vertices; disabled
join_curves = JoinCurves(Curves=decon_brep_2.Edges, Preserve=False)  # -> simplify(Curves); disabled
shift_paths_4 = ShiftPaths(Data=join_curves, Offset=-1)  # disabled

# Internal-Model
# Groups
category_3 = Category(<category referenced from the Revit model>)  # disabled
category_filter_3 = CategoryFilter(Categories=category_3, Inverted=False)  # disabled
and_filter_3 = LogicalAndFilter(FilterA=level_filter, FilterB=category_filter_3)  # disabled
query_elements_3 = QueryElements(Filter=and_filter_3, Limit=100)  # -> simplify(Elements), Count; disabled
element_dependents = ElementDependents(Element=query_elements_3.Elements)  # disabled
unit_z_3 = UnitZ(Factor=1500)  # disabled
elem2geo_3 = ElementGeometry(Elements=element_dependents)  # disabled
region_union = RegionUnion(Curves=shift_paths_4, Plane=xy_plane)  # disabled
shift_paths_5 = ShiftPaths(Data=elem2geo_3, Offset=-1)  # -> simplify(Data); disabled
min_bbox_2 = MinimumBoundingBox3D(Content=shift_paths_5)  # disabled
shift_paths_6 = ShiftPaths(Data=min_bbox_2, Offset=-1)  # disabled
project_along = ProjectAlong(Geometry=shift_paths_6, Plane=xy_plane, Direction=Vector(0, 0, -1))  # -> simplify(Geometry), Transform; disabled
deconstruct_brep_2 = DeconstructBrep(Brep=project_along.Geometry)  # -> Faces, Edges, Vertices; disabled
shift_paths_7 = ShiftPaths(Data=deconstruct_brep_2.Edges, Offset=-1)  # disabled
join_curves_2 = JoinCurves(Curves=shift_paths_7, Preserve=False)  # disabled
merge = Merge(Data1=region_union, Data2=join_curves_2)  # disabled
region_union_2 = RegionUnion(Curves=merge, Plane=xy_plane)  # disabled
region_union_3 = RegionUnion(Curves=region_union_2, Plane=xy_plane)  # -> simplify(Result); disabled
length = Length(Curve=region_union_3)  # disabled
sort_list_2 = SortList(Keys=length, ValuesValuesA=region_union_3)  # -> Keys, ValuesValuesA; disabled
first_last_5 = FirstLast(List=sort_list_2.ValuesValuesA)  # -> FirstValue, LastValue; disabled
brep = Brep(first_last_5.LastValue)  # disabled
extrude_2 = Extrude(Base=brep, Direction=unit_z_3)  # disabled
solid_intersection = SolidIntersection(BrepsA=extrude_2, BrepsB=simplify(min_bbox))  # disabled
volume_3 = Volume(Geometry=solid_intersection)  # -> Volume, Centroid; disabled
nulls_empty = NullsInEmptyBranches(DataWithEmptyBranches=volume_3.Volume)  # disabled
replace_nulls = ReplaceNulls(Items=nulls_empty, Replacements=0)  # -> Items, Count; disabled
first_last_6 = FirstLast(List=replace_nulls.Items)  # -> FirstValue, LastValue; disabled
addition_2 = Addition(A=first_last_6.FirstValue, B=first_last_6.LastValue)  # disabled
multiplication = Multiplication(A=addition_2, _05=0.5)  # disabled

offset_curve = OffsetCurve(Curve=first_last_5.LastValue, Distance=-500, Plane=xy_plane, Corners=1)  # disabled
offset_curve_2 = OffsetCurve(Curve=first_last_5.LastValue, Distance=500, Plane=xy_plane, Corners=1)  # disabled
offset_curve_3 = OffsetCurve(Curve=offset_curve, Distance=800, Plane=xy_plane, Corners=1)  # disabled
offset_curve_4 = OffsetCurve(Curve=offset_curve_2, Distance=-800, Plane=xy_plane, Corners=1)  # disabled
shift_paths_8 = ShiftPaths(Data=offset_curve_3, Offset=-1)  # -> simplify(Data); disabled
shift_paths_9 = ShiftPaths(Data=offset_curve_4, Offset=-1)  # -> simplify(Data); disabled
brep_2 = Brep(shift_paths_8)  # disabled
brep_3 = Brep(shift_paths_9)  # disabled
renumber = RenumberPaths(Data=brep_2)  # -> graft(RenumberedData); disabled
shift_paths_10 = ShiftPaths(Data=offset_curve_3, Offset=-1)  # disabled
renumber_2 = RenumberPaths(Data=brep_3)  # -> graft(RenumberedData); disabled
shift_paths_11 = ShiftPaths(Data=offset_curve_4, Offset=-1)  # disabled
brep_4 = Brep(shift_paths_10)  # disabled
null = NullItem(Item=renumber)  # -> NullFlags, InvalidFlags, Description; disabled
brep_5 = Brep(shift_paths_11)  # disabled
null_2 = NullItem(Item=renumber_2)  # -> NullFlags, InvalidFlags, Description; disabled
unit_z_4 = UnitZ(Factor=1500)  # disabled
renumber_3 = RenumberPaths(Data=brep_4)  # -> graft(RenumberedData); disabled
renumber_4 = RenumberPaths(Data=brep_5)  # -> graft(RenumberedData); disabled
invert = InvertBoolean(Boolean=null.NullFlags)  # -> Inverted, Number; disabled
invert_2 = InvertBoolean(Boolean=null_2.NullFlags)  # -> Inverted, Number; disabled
merge_2 = Merge(Data1=renumber_3, Data2=renumber)  # disabled
dispatch_indices = DispatchIndices(List=merge_2, Indices=invert.Number)  # -> AtI, NotI; disabled
area = Area(Geometry=dispatch_indices.AtI)  # -> Area, Centroid; disabled
merge_3 = Merge(Data1=renumber_4, Data2=renumber_2)  # disabled
dispatch_indices_2 = DispatchIndices(List=merge_3, Indices=invert_2.Number)  # -> AtI, NotI; disabled
area_2 = Area(Geometry=dispatch_indices_2.AtI)  # -> Area, Centroid; disabled
smaller_than = SmallerThan(FirstNumber=area_2.Area, SecondNumber=area.Area)  # -> SmallerThan, OrEqualTo; disabled
invert_3 = InvertBoolean(Boolean=smaller_than.SmallerThan)  # -> Inverted, Number; disabled
merge_4 = Merge(Data1=dispatch_indices_2.AtI, Data2=dispatch_indices.AtI)  # disabled
merge_5 = Merge(Data1=area_2.Area, Data2=area.Area)  # disabled
merge_6 = Merge(Data1=smaller_than.SmallerThan, Data2=invert_3.Inverted)  # disabled
dispatch = Dispatch(List=merge_5, DispatchPattern=merge_6)  # -> ListA, ListB; disabled
smaller_than_2 = SmallerThan(FirstNumber=dispatch.ListA, SecondNumber=100000000)  # -> SmallerThan, OrEqualTo; disabled
invert_4 = InvertBoolean(Boolean=smaller_than_2.SmallerThan)  # -> Inverted, Number; disabled
list_item_6 = ListItem(List=merge_6, Index=invert_4.Number, Wrap=True)  # disabled
invert_5 = InvertBoolean(Boolean=list_item_6)  # -> Inverted, Number; disabled
merge_7 = Merge(Data1=invert_5.Inverted, Data2=list_item_6)  # disabled
dispatch_2 = Dispatch(List=merge_4, DispatchPattern=merge_7)  # -> ListA, ListB; disabled
extrude_3 = Extrude(Base=dispatch_2.ListA, Direction=unit_z_4)  # disabled
solid_intersection_2 = SolidIntersection(BrepsA=extrude_3, BrepsB=simplify(min_bbox))  # disabled
volume_4 = Volume(Geometry=solid_intersection_2)  # -> Volume, Centroid; disabled
nulls_empty_2 = NullsInEmptyBranches(DataWithEmptyBranches=volume_4.Volume)  # disabled
replace_nulls_2 = ReplaceNulls(Items=nulls_empty_2, Replacements=0)  # -> Items, Count; disabled
first_last_7 = FirstLast(List=replace_nulls_2.Items)  # -> FirstValue, LastValue; disabled
addition_3 = Addition(A=first_last_7.FirstValue, B=first_last_7.LastValue)  # disabled

larger_than_2 = LargerThan(FirstNumber=addition_3, SecondNumber=multiplication)  # -> simplify(LargerThan), OrEqualTo; disabled
panel_7 = Panel("Internal_Wall")  # disabled
panel_8 = Panel("External_Wall")  # disabled
expression_2 = Expression(x=larger_than_2.LargerThan, y=panel_7, z=panel_8, Expression="If(x=True, y, z)")  # disabled
renumber_paths = RenumberPaths(Data=expression_2)  # disabled

panel_9 = Panel("Wall_with_Openings")  # disabled
panel_10 = Panel("Generic_Wall")  # disabled
expression_3 = Expression(x=query_elements.Count, y=larger_than.LargerThan, z=panel_10, u=panel_9, Expression="If(x<2, u, If(y=true, u, z))")  # disabled
renumber_paths_2 = RenumberPaths(Data=expression_3)  # disabled

# ---- group: Else
bounding_box = BoundingBox(Content=elem2geo, Plane=PlaneXY(0, 0, 0))  # -> Box, Box_2; disabled
decon_brep_3 = DeconstructBrep(Brep=bounding_box.Box)  # -> Faces, Edges, Vertices; disabled
box_properties_2 = BoxProperties(Box=decon_brep_3.Faces)  # -> Center, Diagonal, Area, Volume, Degeneracy; disabled
volume_5 = Volume(Geometry=bounding_box.Box)  # -> Volume, Centroid; disabled
decon_vec_3 = DeconstructVector(Vector=box_properties_2.Diagonal)  # -> XComponent, YComponent, ZComponent; disabled
sort_list_3 = SortList(Keys=decon_vec_3.ZComponent, ValuesValuesA=decon_brep_3.Faces)  # -> Keys, ValuesValuesA; disabled
first_last_8 = FirstLast(List=sort_list_3.ValuesValuesA)  # -> FirstValue, LastValue; disabled
area_3 = Area(Geometry=first_last_8.FirstValue)  # -> Area, Centroid; disabled
division = Division(A=volume_5.Volume, B=area_3.Area)  # disabled
integer = Integer(division)  # disabled

# Height Offset
parameter_2 = Parameter(<parameter referenced from the Revit model>, SelectedBuiltInCategory="autodesk.revit.category.local:floors")  # disabled
element_parameter_2 = ElementParameter(Element=query_element, Parameter=parameter_2)  # -> Element, graft(Value); disabled
equality = Equality(FirstNumber=element_parameter_2.Value, SecondNumber=-50)  # -> Equality, Inequality; disabled
equality_2 = Equality(FirstNumber=element_parameter_2.Value, SecondNumber=-130)  # -> Equality, Inequality; disabled

decon_brep_4 = DeconstructBrep(Brep=elem2geo)  # -> Faces, Edges, Vertices; disabled
area_4 = Area(Geometry=decon_brep_4.Faces)  # -> Area, Centroid; disabled
sort_list_4 = SortList(Keys=area_4.Area, ValuesValuesA=decon_brep_4.Faces)  # -> Keys, ValuesValuesA; disabled
first_last_9 = FirstLast(List=sort_list_4.Keys)  # -> FirstValue, LastValue; disabled
panel_11 = Panel()  # disabled
null_3 = NullsInEmptyBranches(DataWithEmptyBranches=panel_11)  # disabled
replace_nulls_3 = ReplaceNulls(Items=first_last_9.LastValue, Replacements=null_3)  # -> Items, Count; disabled
expression_4 = Expression(x=replace_nulls_3.Items, y=volume_2.Volume, z=null_3, Expression="If(x=z, y, x)")  # disabled
larger_than_3 = LargerThan(FirstNumber=expression_4, SecondNumber=1500000)  # -> LargerThan, OrEqualTo; disabled
smaller_than_3 = SmallerThan(FirstNumber=expression_4, SecondNumber=10000000)  # -> SmallerThan, OrEqualTo; disabled

division_2 = Division(A=volume.Volume, B=first_last_9.LastValue)  # disabled
integer_2 = Integer(division_2)  # disabled

equality_3 = Equality(FirstNumber=simplify(integer_2), SecondNumber=simplify(integer))  # -> Equality, Inequality; disabled
panel_12 = Panel("Flat Slab")  # disabled
panel_13 = Panel("Sloped Slab")  # disabled
expression_5 = Expression(x=equality_3.Equality, y=panel_12, z=panel_13, Expression="If(x=True, y, z)")  # disabled
renumber_paths_3 = RenumberPaths(Data=expression_5)  # disabled

gate_and = GateAnd(Flat=equality_3.Equality, A=smaller_than_3.OrEqualTo, B=larger_than_3.LargerThan)  # disabled

gate_or = GateOr(A=gate_and, B=equality.Equality, C=equality_2.Equality)  # disabled
panel_14 = Panel("Toilet Slab")  # disabled
panel_15 = Panel("Generic Slab")  # disabled
expression_6 = Expression(x=gate_or, y=panel_15, z=panel_14, Expression="If(x=True, z, y)")  # disabled
renumber_paths_4 = RenumberPaths(Data=expression_6)  # disabled

# ---- group: Export
graft = GraftTree(Tree=text, IncludeEmptyLists=True, IncludeNullItems=True)  # -> simplify(Tree)
re_path = RenumberPaths(Data=graft)
multiple_elements_merge = Merge(Data1=re_path, Data2=renumber_paths_2, Data3=renumber_paths, Data4=renumber_paths_3, Data5=renumber_paths_4)  # -> flatten(Result)
contents = Panel(multiple_elements_merge)
file_name = Panel("입력")
next_available_filename = NextAvailableFilename(Format="total_process_{0:000}.txt", FolderPath=file_name, Trigger=text_split)  # -> flatten(FilePath)
panel_16 = Panel(next_available_filename)
write_to_text_file = WriteToTextFile(Run=Toggle(False), TextToWrite=contents, FilePath=next_available_filename, Append=False, NewOnly=False)
panel_17 = Panel(write_to_text_file)
